# Grasshopper definition MapDesign.ghx (Grasshopper 1.0.8)
# plug-ins: Rhino.Inside–ArcGIS

map = Map()  # -> Maps, Names
layers = MapLayers(Map=map.Maps)  # -> Layers, Names, Capabilities
item = ListItem(List=layers.Layers, Index=0, Wrap=True)
read = ReadFeatures(Layer=item, SelectedOnly=True, Limit=1000)  # -> Features, Truncated
geometry = FeatureGeometry(Features=read.Features)  # -> Geometry, Identity, MatchingFeatures
field = Field(Name="height_m", Type="Double", Nullable=True, Length=255)
create = CreateLayer(Map=map.Maps, Name="GH_Design_Example", Shape="Multipatch", Fields=field)
lift_model_units = Slider(0, range=0..50)
Z = UnitZ(Factor=lift_model_units)
move = Move(Geometry=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, Motion=Z)  # -> Geometry, Transform
feature = BuildFeature(Geometry=move.Geometry, Key="massing-001")
set_attribute = SetAttribute(Feature=feature, Field="height_m", Value=30)
append = AppendFeatures(Layer=create, Features=set_attribute)
preview = MapPreview(Map=map.Maps, Geometry=move.Geometry, Color=RGBA(30, 180, 220, 160), Width=2, Enabled=True)
